# Dynamo graph OM_Gerar_Pontos.dyn (Dynamo 2.13.1.3887)

categories = Categories("OST_StructuralColumns")
all_elements_of_category = ElementsOfCategory(Category=categories)
gerar_o_arquivo_excell = CodeBlock(O=all_elements_of_category)  # "Gerar o arquivo Excell Atualizado"
# ---------- gerar_o_arquivo_excell.designscript (11 lines) ----------
O;
Pasta   = "C:\\WOM\\out-files\\";
ArqNo   = "CT_Colunas.txt";
Arquivo = Pasta + ArqNo;
Loc     = FamilyInstance.GetLocation(O);
x1      = Loc.X;
y1      = Loc.Y;
z1      = Loc.Z;

xyz     = x1 + "\n" + y1 + "\n" + z1;
DSOffice.Data.ExportCSV(Arquivo ,  xyz );
# ----------------------------------------
watch = Watch(gerar_o_arquivo_excell.O)
watch_2 = Watch(gerar_o_arquivo_excell.x1)
